# Dynamo graph CaseStudy_Clinic.dyn (Dynamo 2.0.1.5055)

number_slider = DoubleSlider(30, range=15..70 step 0.1)
code_block = CodeBlock(a=number_slider)
# ---------- code_block.designscript (6 lines) ----------
A = Point.ByCoordinates(-a, -a);
B = Point.ByCoordinates(a, -a);
C = Point.ByCoordinates(a, a);
D = Point.ByCoordinates(-a, a);
[A, B, C, D];
true;
# ----------------------------------------
byPoints = PolyCurve.ByPoints(points=code_block.out4, connectLastToFirst=code_block.out5)

# group: Bring in the Program
file_path = Filename(".\SampleBuildingProgram-Clinic.csv")
file_from_path = FileObject(path=file_path)
code_block_2 = CodeBlock { "SampleBuildingProgram-Clinic"; false; }
importExcel = Data.ImportExcel(file=file_from_path, sheetName=code_block_2.out0, showExcel=code_block_2.out1)

flatten = List.Flatten(list=importExcel)
watch = Watch(flatten)
create = DynaShape.ZeroTouch.SpacePlanning.Create(data=watch)
iterations = IntegerSlider(0, range=0..100 step 1)
reset = BoolSelector(true)
execute = BoolSelector(false)
manipulate = BoolSelector(true)
damping_factor = DoubleSlider(0, range=0..0.97 step 0.01)
boundary_strength = DoubleSlider(10, range=0..10 step 0.01)
global_positioning_strength = DoubleSlider(100, range=0..100 step 0.01)
sphere_collision_strength = DoubleSlider(20, range=0..20 step 0.01)
department_cohesion_strength = DoubleSlider(0.014, range=0..0.03 step 0.001)
space_adj_strength = DoubleSlider(0.05, range=0..1 step 0.01)
space_department_adj_strength = DoubleSlider(0, range=0..1 step 0.01)
show_space_names = BoolSelector(false)
show_adj_space_space = BoolSelector(true)
show_adj_space_dept = BoolSelector(false)
# note: NOTE:
# When "Execute" is set to False, the solver will pause and output real dynamio gemetries together with the current error measurements for the adjacency constraints
execute_2 = DynaShape.ZeroTouch.SpacePlanning.Execute(engine=create, iterations=iterations, reset=reset, execute=execute, enableManipulation=manipulate, dampingFactor=damping_factor, BoundaryVertices=code_block.out4, BoundaryStrength=boundary_strength, globalPositioningStrength=global_positioning_strength, sphereCollisionStrength=sphere_collision_strength, departmentCohesionStrength=department_cohesion_strength, spaceAdjacencyStrength=space_adj_strength, spaceDepartmentAdjacencyStrength=space_department_adj_strength, showSpaceNames=show_space_names, showSpaceAdjacency=show_adj_space_space, showSpaceDepartmentAdjacency=show_adj_space_dept)
watch_2 = Watch(execute_2.spaceAdjErrors)
watch_3 = Watch(execute_2.spaceAdjErrorRatios)
